# Grasshopper definition AttractorTest.gh (Grasshopper 0.9.75)

cell_radius = Slider(0.8, range=0..1)
of_cells = Slider(28, range=1..30)
geo = Geometry([Point(5.232601991, 5.496858825, 1.424586682), Point(23.37655666, 11.01251495, 1.001685205), Point(2.800038318, 21.39290831, 1.202022246), Point(25.17118941, 32.30111953, 2.088371332)])
xy = XYPlane(Origin=Point(0, 0, 0))
pt = Point(geo)
hexgrid = Hexagonal(Plane=xy, Size=cell_radius, ExtentX=of_cells, ExtentY=of_cells)  # -> Cells, graft(Points)
ln = Line(StartPoint=pt, EndPoint=hexgrid.Points)
vec2pt = Vector2Pt(PointA=hexgrid.Points, PointB=pt, Unitize=False)  # -> Vector, Length
division = Division(A=1, B=vec2pt.Length)
pow = Power(A=division, B=Slider(2, range=0..10))
clean = CleanTree(Tree=vec2pt.Vector, CleanInvalid=True, CleanEmpty=False)
clean_2 = CleanTree(Tree=pow, CleanInvalid=True, CleanEmpty=False)
simplify = SimplifyTree(Tree=clean, Front=False)
simplify_2 = SimplifyTree(Tree=clean_2, Front=False)
wav = WeightedAverage(Input=simplify, Weights=simplify_2)
panel = Panel(wav)
circle = CircleCNR(Center=hexgrid.Points, Normal=panel, Radius=cell_radius)
X = UnitX(Factor=1)
Y = UnitY(Factor=1)
offset = Offset(Curve=circle, Distance=Slider(-0.14, range=-1..1), Plane=xy, Corners=1)
Z = UnitZ(Factor=1)
dprod = DotProduct(VectorA=panel, VectorB=Z, Unitize=False)
boundary = BoundarySurfaces(Edges=offset)
