# Grasshopper definition Sensor Simulator.gh (Grasshopper 0.9.75)
# plug-ins: Firefly.Core

timer = Timer(TimerInterval=1000, Target=fader1)
fader1 = FaderOneWay(Value1="1", Value2="500", FadeInterval="50000", DelayOut=0)  # -> FadingOutput, LoopCounter
random = Random(Range=Domain(0, 1024), Number=12, Seed=fader1.FadingOutput)
round = Round(Number=random)  # -> Nearest, Floor, Ceiling
panel = Panel(round.Nearest)
dispatch = Dispatch(List=panel, DispatchPattern=Button())  # -> graft(ListA), ListB
rec = DataRecorder(dispatch.ListA, DataLimit=-10, RecordData=True)
lng = ListLength(List=rec)
subtraction = Subtraction(A=lng, B=1)
item = ListItem(List=rec, Index=subtraction, Wrap=True)
panel_2 = Panel(item)
