# Grasshopper definition boxMorph.gh (Grasshopper 0.9.75)

srf = Surface(<surface referenced from the Rhino model>)
geo = Geometry(<brep referenced from the Rhino model>)
divide = DivideDomain²(Domain=srf, UCount=Slider(4, range=0..10), VCount=Slider(10, range=0..10))
bbox = BoundingBox(Content=geo, Plane=PlaneXY(0, 0, 0))  # -> Box, Box_2
sbox = SurfaceBox(Surface=srf, Domain=divide, Height=Slider(13, range=0..50))
morph = BoxMorph(Geometry=geo, Reference=bbox.Box, Target=sbox)
