# Grasshopper definition constructBaseChair.gh (Grasshopper 0.9.75)

flex_short_l = Slider(55, range=0..100)
softpot_l = Slider(33, range=0..100)
flex_short_r = Slider(41, range=0..100)
softpot_r = Slider(35, range=0..100)
flex_long_r = Slider(47, range=0..100)
ultrasound = Slider(33, range=0..100)
accelerometer = Slider(3, range=1..8)
xy = XYPlane(Origin=Point(0, 0, 0))
flex_long_l = Slider(12, range=0..40)
fsr_r = Slider(60, range=0..100)
temp = Slider(17, range=0..30)
fsr_l = Slider(39, range=0..100)
prot = RotatePlane(Plane=xy, Angle=4.71238898)
larger = LargerThan(FirstNumber=flex_short_l, SecondNumber=flex_short_r)  # -> LargerThan, OrEqualTo
cir = Circle(Plane=prot, Radius=100)
expression = Expression(x=larger.LargerThan, A=flex_short_r, B=flex_short_l, Expression="If(x, A, B)")
addition = Addition(A=flex_long_l, B=30)
addition_2 = Addition(A=flex_long_l, B=temp)
divide = DivideCurve(Curve=cir, Count=accelerometer, Kinks=False)  # -> Points, Tangents, Parameters
subtraction = Subtraction(A=flex_long_r, B=expression)
ln = Line(StartPoint=xy, EndPoint=divide.Points)
sqrt = SquareRoot(Value=accelerometer)
Z = UnitZ(Factor=1)
Z_2 = UnitZ(Factor=1)
division = Division(A=flex_short_l, B=-2)
xy_2 = XYPlane(Origin=Point(0, 0, 0))
division_2 = Division(A=flex_short_r, B=-2)
division_3 = Division(A=flex_long_l, B=sqrt)
division_4 = Division(A=subtraction, B=-2)
multiplication = Multiplication(A=ultrasound, B=-1)
multiplication_2 = Multiplication(A=division_3, B=-2)
offset = Offset(Curve=ln, Distance=graft([division_3, multiplication_2]), Plane=PlaneXY(0, 0, 0), Corners=2)  # -> simplify(Curve)
addition_3 = Addition(A=division_4, B=division_2)
addition_4 = Addition(A=division_4, B=division)
multiplication_3 = Multiplication(A=Z, B=addition)
subtraction_2 = Subtraction(A=flex_short_l, B=fsr_r)
multiplication_4 = Multiplication(A=Z_2, B=fsr_l)
pt = ConstructPoint(XCoordinate=division, YCoordinate=division_2, ZCoordinate=0)
division_5 = Division(A=subtraction_2, B=2)
pt_2 = ConstructPoint(XCoordinate=addition_4, YCoordinate=addition_3, ZCoordinate=0)
number_slider = Slider(3, range=0..10)
path_mapper = PathMapper(offset, source="{A;B}", target="{B}(A)")
addition_5 = Addition(A=subtraction, B=flex_short_l)
addition_6 = Addition(A=subtraction, B=flex_short_r)
rectangle = Rectangle(Plane=pt, XSize=flex_short_l, YSize=flex_short_r, Radius=0)  # -> Rectangle, Length
boxrec = BoxRectangle(Rectangle=rectangle.Rectangle, Height=flex_long_l)
X = UnitX(Factor=1)
multiplication_5 = Multiplication(A=X, B=division_5)
pl_offset = PlaneOffset(BasePlane=pt_2, Offset=multiplication)
cp = ControlPoints(Curve=path_mapper)  # -> Points, Weights, Knots
path_mapper_2 = PathMapper(cp.Points, source="{A;B}(i)", target="{A}")
debrep = DeconstructBrep(Brep=boxrec)  # -> Faces, Edges, Vertices
multiplication_6 = Multiplication(A=softpot_l, B=-1)
multiplication_7 = Multiplication(A=flex_long_l, B=-1)
panel = Panel("""0
1
3
2""")
rectangle_2 = Rectangle(Plane=pl_offset, XSize=addition_5, YSize=addition_6, Radius=0)  # -> Rectangle, Length
item = ListItem(List=debrep.Vertices, Index=3, Wrap=True)
pl_origin = PlaneOrigin(Base=xy_2, Origin=item)
prune = PruneTree(Tree=cp.Points, Minimum=0, Maximum=0)
rectangle_3 = Rectangle(Plane=item, XSize=multiplication_7, YSize=multiplication_6, Radius=0)  # -> Rectangle, Length
rectangle_4 = Rectangle(Plane=item, XSize=flex_short_l, YSize=flex_long_l, Radius=0)  # -> Rectangle, Length
item_2 = ListItem(List=path_mapper_2, Index=panel, Wrap=True)
loft = Loft(
    Curves=[rectangle_2.Rectangle, rectangle.Rectangle],
    Options={Adjust=False, Closed=False, LoftEnds=0, LoftSimp=0, LoftType=0, Rebuild=10, Refit=0.01})
pl_offset_2 = PlaneOffset(BasePlane=pl_origin, Offset=multiplication_3)
pl_offset_3 = PlaneOffset(BasePlane=pl_offset_2, Offset=multiplication_4)
deplane = DeconstructPlane(Plane=pl_offset_3)  # -> Origin, XAxis, YAxis, ZAxis
addition_7 = Addition(A=deplane.Origin, B=multiplication_5)
pl = ConstructPlane(Origin=addition_7, XAxis=deplane.XAxis, YAxis=deplane.YAxis)
Z_3 = UnitZ(Factor=1)
pline = PolyLine(Vertices=item_2, Closed=True)
boxrec_2 = BoxRectangle(Rectangle=rectangle_4.Rectangle, Height=addition_2)
boxrec_3 = BoxRectangle(Rectangle=rectangle_3.Rectangle, Height=softpot_r)
cap = CapHoles(Brep=loft)
rectangle_5 = Rectangle(Plane=pl_offset_2, XSize=flex_short_l, YSize=flex_long_l, Radius=0)  # -> Rectangle, Length
rectangle_6 = Rectangle(Plane=pl, XSize=fsr_r, YSize=flex_long_l, Radius=0)  # -> Rectangle, Length
equals = Equality(FirstNumber=accelerometer, SecondNumber=1)  # -> Equality, Inequality
multiplication_8 = Multiplication(A=Z_3, B=ultrasound)
loft_2 = Loft(
    Curves=[rectangle_5.Rectangle, rectangle_6.Rectangle],
    Options={Adjust=False, Closed=False, LoftEnds=0, LoftSimp=0, LoftType=0, Rebuild=10, Refit=0.01})
mirror = Mirror(Geometry=boxrec_3, Plane=PlaneYZ(0, 0, 0))  # -> Geometry, Transform
multiplication_9 = Multiplication(A=multiplication_8, B=-1.1)
extr = Extrude(Base=pline, Direction=multiplication_9)
dispatch = Dispatch(List=cap, DispatchPattern=equals.Equality)  # -> ListA, ListB
cap_2 = CapHoles(Brep=extr)  # -> flatten(Brep)
sdiff = SolidDifference(BrepsA=cap, BrepsB=cap_2)  # -> graft(Result)
geo = Geometry([cap, sdiff])
dispatch_2 = Dispatch(List=sdiff, DispatchPattern=equals.Inequality)  # -> ListA, ListB
cap_3 = CapHoles(Brep=loft_2)
geo_2 = Geometry([dispatch.ListA, dispatch_2.ListA])
number_slider_2 = Slider(20, range=0..100)
geo_3 = Geometry(flatten([geo_2, cap_3, boxrec_2, mirror.Geometry, boxrec_3, boxrec]))
number_slider_3 = Slider(7, range=0..10)  # disabled
number_slider_4 = Slider(18, range=0..100)  # disabled
pop3d = Populate3D(Region=geo_3, Count=number_slider_4, Seed=number_slider_3)  # -> flatten(Population); disabled
brepsinc = PointInBreps(Brep=geo_3, Point=pop3d, Strict=False)  # -> Inside, Index; disabled
dispatch_3 = Dispatch(List=pop3d, DispatchPattern=brepsinc.Inside)  # -> ListA, ListB; disabled
pt_3 = Point(dispatch_3.ListA)  # disabled
index = ItemIndex(List=pt_3, Item=pt_3)  # -> graft(Index); disabled
cull_i = CullIndex(List=pt_3, Indices=index, Wrap=True)  # disabled
con = DelaunayEdges(Points=pt_3, Plane=PlaneXY(0, 0, 0))  # -> Connectivity, Edges; disabled
cp_2 = ClosestPoint(Point=pt_3, Cloud=cull_i)  # -> ClosestPoint, CPIndex, Distance; disabled
ln_2 = Line(StartPoint=pt_3, EndPoint=cp_2.ClosestPoint)  # disabled
