# Grasshopper definition generativeShapes.gh (Grasshopper 0.9.75)

cell_radius = Slider(0.8, range=0..1)
of_cells = Slider(28, range=1..30)
geo = Geometry([<point referenced from the Rhino model> x4])
xy = XYPlane(Origin=Point(0, 0, 0))
pt = Point(geo)
hexgrid = Hexagonal(Plane=xy, Size=cell_radius, ExtentX=of_cells, ExtentY=of_cells)  # -> Cells, graft(Points)
ln = Line(StartPoint=pt, EndPoint=hexgrid.Points)
vec2pt = Vector2Pt(PointA=hexgrid.Points, PointB=pt, Unitize=False)  # -> Vector, Length
division = Division(A=1, B=vec2pt.Length)
pow = Power(A=division, B=Slider(2, range=0..10))
clean = CleanTree(Tree=vec2pt.Vector, CleanInvalid=True, CleanEmpty=False)
clean_2 = CleanTree(Tree=pow, CleanInvalid=True, CleanEmpty=False)
simplify = SimplifyTree(Tree=clean_2, Front=False)
simplify_2 = SimplifyTree(Tree=clean, Front=False)
wav = WeightedAverage(Input=simplify_2, Weights=simplify)
avr = Average(Input=simplify_2)
panel = Panel(wav)
circle = CircleCNR(Center=hexgrid.Points, Normal=panel, Radius=cell_radius)
offset = Offset(Curve=circle, Distance=Slider(-0.17, range=-1..1), Plane=xy, Corners=1)
boundary = BoundarySurfaces(Edges=offset)
