# Grasshopper definition kangarooTest.gh (Grasshopper 0.9.75)
# plug-ins: Firefly.X, Weaverbird, Kangaroo2 Components

mplane = MeshPlane(Boundary={Plane=PlaneXY(0, 0, 0), Size=Domain2(u=-10..10, v=-10..10)}, WidthCount=10, HeightCount=10)  # -> Mesh, Area
mc = MeshCorners(Mesh=mplane.Mesh, Angle=2.35619449)
wbedges = WeaverbirdsMeshEdges(MeshOrPolylines=mplane.Mesh)
grab = Grab(On=True, Strength=1, Range=3)  # -> Grab, Anchors
len = Length(Curve=wbedges)
demesh = DeconstructMesh(Mesh=mplane.Mesh)  # -> Vertices, Faces, Colours, Normals
Z = UnitZ(Factor=Slider(0.29, range=0..1))
multiplication = Multiplication(A=len, B=Slider(0.79, range=0..1))
anchor = Anchor(Point=mc, Strength=10000)
show = Show(G=mplane.Mesh)
length_line = LengthLine(Line=wbedges, Length=multiplication, Strength=Slider(4, range=0..10))
load = Load(Point=demesh.Vertices, ForceVector=Z)
timer = Timer(TimerInterval=20, Target=counter)
counter = Counter(CountDirection=True, Step=1, StartStop=True, Reset=Button(), OptionalCounterDomain=Domain(0, 100))
merge = Merge(Data1=length_line, Data2=load, Data3=anchor, Data4=show, Data5=grab.Grab)
stepsolver = StepSolver(Tolerance=0.01, Momentum=False, Damping=0.99, SubIterations=Slider(1, range=0..50), Animate=counter)  # -> I, V, O
solver = Solver(Reset=False, Threshold=1e-15, Tolerance=0.01, On=True)  # -> I, V, O
bouncysolver = BouncySolver(
    GoalObjects=merge,
    Reset=Button(),
    Threshold=1e-15,
    Tolerance=0.01,
    Damping=0.99,
    Iterations=Slider(9, range=0..50),
    On=True)  # -> I, V, O
geo = Geometry(bouncysolver.O)
geo_2 = Geometry(stepsolver.O)
