# Grasshopper definition poincloudChair.gh (Grasshopper 0.9.75)
# plug-ins: Weaverbird

geo = Geometry([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])
geo_2 = Geometry([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])
join = BrepJoin(Breps=geo)  # -> Breps, Closed
pop3d = Populate3D(Region=geo_2, Count=Slider(2, range=1..5), Seed=Slider(237, range=0..500))  # -> flatten(Population)
mesh = MeshBrep(
    Brep=join.Breps,
    Settings={GridMaxCount=0, GridMinCount=16, JaggedSeams=False, MaxEdgeLength=0, MinEdgeLength=0.0001, MinTolerance=0, Refine=True, RefineAngle=0, RelativeTolerance=0.65, SimplePlanes=True, Tolerance=0})
pop2d = Populate2D(Region=geo, Count=Slider(14, range=0..100), Seed=1)
cluster = Cluster_3(P=pop3d)  # disabled
cluster_2 = Cluster(P=pop3d)  # disabled
cluster_3 = Cluster_4(A=pop3d, G=pop3d)  # disabled
cluster_4 = Cluster_5(P=pop3d)  # disabled
cluster_5 = Cluster_7(P=pop3d)  # disabled
cluster_6 = Cluster_2(M=mesh, G_2=mesh, G=mesh)  # disabled
del = DelaunayMesh(Points=pop2d, Plane=graft(geo))  # disabled
geo_3 = Geometry(cluster_6)
geo_4 = Geometry(cluster_2)
geo_5 = Geometry(cluster)
geo_6 = Geometry(cluster_5)
geo_7 = Geometry(cluster_3)
geo_8 = Geometry(cluster_4)
cluster_7 = Cluster_6(L_2=pop3d, L=pop3d, P=pop3d, T=pop3d)  # -> U, S; disabled
cluster_8 = Cluster_8(C=pop3d, P=pop3d, L=pop3d, P_2=pop3d)  # disabled
geo_9 = Geometry(cluster_7.S)
geo_10 = Geometry(cluster_8)
del_2 = DelaunayMesh(Points=pop3d, Plane=PlaneXY(0, 0, 0))
wbstellate = WeaverbirdsStellateCumulation(MeshPolylines=del_2, Distance=Slider(0, range=0..100))
wbframe = WeaverbirdsPictureFrame(MeshPolylines=del_2, Distance=Slider(1, range=1..30), InsetType=0)

wbtriangles = WeaverbirdsSplitTrianglesSubdivision(MeshCurves=del_2, Level=1)
wbloop = WeaverbirdsLoopSubdivision(MeshCurves=wbtriangles, Level=Slider(3, range=1..3), SmoothNakedEdges=1)

wbbevelvertices = WeaverbirdsBevelVertices(MeshPolylines=wbloop, Distance=Slider(30, range=15..50), InsetType=0, OutputGeometryAsMesh=True)
wbframe_2 = WeaverbirdsPictureFrame(MeshPolylines=wbloop, Distance=Slider(2, range=1..40), InsetType=0)
wbbeveledges = WeaverbirdsBevelEdges(MeshPolylines=wbloop, Distance=Slider(30, range=1..50), InsetType=0)
wbthicken = WeaverbirdsMeshThicken(MeshCurves=wbbevelvertices, Distance=Slider(0.4, range=0.25..1), OffsetType=0)
geo_11 = Geometry(wbthicken)

# ==== cluster Cluster
P = ClusterInput()
con = DelaunayEdges(Points=P, Plane=PlaneXY(0, 0, 0))  # -> flatten(Connectivity), Edges
len = Length(Curve=con.Edges)
smaller = SmallerThan(FirstNumber=len, SecondNumber=Slider(49, range=0..100))  # -> SmallerThan, OrEqualTo
cull = CullPattern(List=con.Edges, CullPattern=smaller.SmallerThan)
pipe = Pipe(Curve=cull, Radius=Slider(4.4, range=0..10), Caps=0)
P_2 = ClusterOutput(pipe)

# ==== cluster Cluster_2
G = ClusterInput()
M = ClusterInput()
wbedges = WeaverbirdsMeshEdges(MeshOrPolylines=G)
number_slider = Slider(1, range=0..27)
len = Length(Curve=wbedges)
mc = MeshCorners(Mesh=M, Angle=2.35619449)
multiplication = Multiplication(A=len, B=Slider(0.73, range=0..1))
reduce = RandomReduce(List=mc, Reduction=number_slider, Seed=number_slider)
G_2 = ClusterInput()
length_line = LengthLine(Line=wbedges, Length=multiplication, Strength=10)
anchor = Anchor(Point=reduce, Strength=Slider(0.491, range=0..1))
show = Show(G=G_2)
toggle = BooleanToggle(True)
merge = Merge(Data1=anchor, Data2=length_line, Data3=show)
bouncysolver = BouncySolver(
    GoalObjects=merge,
    Reset=Button(),
    Threshold=Slider(0, range=0..0.01),
    Tolerance=0.01,
    Damping=0.99,
    Iterations=10,
    On=True)  # -> I, V, O
geo = Geometry(bouncysolver.O)
panel = Panel(geo)
expression = Expression(x=panel, Expression="Contains (x,\"Mesh\")")
cull = CullPattern(List=geo, CullPattern=expression)
number_slider_2 = Slider(0.04, range=0..0.1)
wbframe = WeaverbirdsPictureFrame(MeshPolylines=cull, Distance=Slider(10, range=0..100), InsetType=0)
wbcatmullclark = WeaverbirdsCatmullClarkSubdivision(MeshCurves=wbframe, Level=Slider(3, range=1..3), SmoothNakedEdges=1)
O = ClusterOutput(wbcatmullclark)

# ==== cluster Cluster_3
P = ClusterInput()
voronoi³ = Voronoi3D(Points=P)  # -> Cells, Boundary
not = GateNot(A=voronoi³.Boundary)
cull = CullPattern(List=voronoi³.Cells, CullPattern=not)
reduce = RandomReduce(List=voronoi³.Cells, Reduction=Slider(14, range=0..100), Seed=1)
sunion = SolidUnion(Breps=cull)
mesh = MeshBrep(
    Brep=sunion,
    Settings={GridMaxCount=0, GridMinCount=16, JaggedSeams=False, MaxEdgeLength=0, MinEdgeLength=0.0001, MinTolerance=0, Refine=True, RefineAngle=0, RelativeTolerance=0.65, SimplePlanes=True, Tolerance=0})
M = ClusterOutput(mesh)

# ==== cluster Cluster_4
pt = Point(Point(26.85665709, 96.33762242, 0))
A = ClusterInput()
ln = Line(StartPoint=A, EndPoint=pt)
len = Length(Curve=ln)
G = ClusterInput()
multiplication = Multiplication(A=len, B=Slider(0.32, range=0..1))
show = Show(G=[ln, G])
length_line = LengthLine(Line=ln, Length=multiplication, Strength=Slider(0.04, range=0..0.1))
merge = Merge(Data3=show, Data4=length_line)
bouncysolver = BouncySolver(
    GoalObjects=merge,
    Reset=Button(),
    Threshold=1e-15,
    Tolerance=0.01,
    Damping=Slider(0.04, range=0..0.1),
    Iterations=Slider(3, range=0..10),
    On=True)  # -> I, V, O
O = ClusterOutput(bouncysolver.O)

# ==== cluster Cluster_5
P = ClusterInput()
oct = OcTree(Points=P, Square=False, Group=Slider(2, range=0..10))  # -> Boxes, Points
B = ClusterOutput(oct.Boxes)

# ==== cluster Cluster_6
L = ClusterInput()
lng = ListLength(List=L)
subtraction = Subtraction(A=lng, B=1)
range = Range(Domain=subtraction, Steps=subtraction)
L_2 = ClusterInput()
graft = GraftTree(Tree=range, IncludeEmptyLists=True, IncludeNullItems=True)  # -> simplify(Tree)
cull_i = CullIndex(List=L_2, Indices=graft, Wrap=True)
P = ClusterInput()
cps = ClosestPoints(Point=graft(P), Cloud=cull_i, Count=Slider(2, range=1..3))  # -> ClosestPoint, CPIndex, Distance
T = ClusterInput()
graft_2 = GraftTree(Tree=T, IncludeEmptyLists=True, IncludeNullItems=True)  # -> graft(Tree)
ln = Line(StartPoint=cps.ClosestPoint, EndPoint=graft_2)
sunion = SetUnion(SetA=cps.ClosestPoint, SetB=graft_2)
U = ClusterOutput(sunion)
item = ListItem(List=sunion, Index=0, Wrap=True)  # -> flatten(Item)
item_2 = ListItem(List=sunion, Index=1, Wrap=True)  # -> flatten(Item)
item_3 = ListItem(List=sunion, Index=2, Wrap=True)  # -> flatten(Item)
srf4pt = _4PointSurface(CornerA=item, CornerB=item_2, CornerC=item_3)
S = ClusterOutput(srf4pt)

# ==== cluster Cluster_7
P = ClusterInput()
srfgrid = SurfaceFromPoints(Points=P, UCount=Slider(12, range=1..100), Interpolate=False)
S = ClusterOutput(srfgrid)

# ==== cluster Cluster_8
C = ClusterInput()
P = ClusterInput()
P_2 = ClusterInput()
L = ClusterInput()
bbox = BoundingBox(Content=C, Plane=PlaneXY(0, 0, 0), UnionBox=True)  # -> Box, Box_2
edges = BrepEdges(Brep=bbox.Box)  # -> Naked, Interior, NonManifold
number_slider = Slider(8, range=1..20)
item = ListItem(List=edges.Interior, Index=Slider(6, range=0..11), Wrap=True)
subtraction = Subtraction(A=number_slider, B=1)
len = Length(Curve=item)
pframes = PerpFrames(Curve=item, Count=number_slider, Align=True)  # -> Frames, Parameters
division = Division(A=len, B=number_slider)
multiplication = Multiplication(A=Slider(119, range=100..1000), B=-1)
rectangle = Rectangle(Plane=pframes.Frames, XSize=multiplication, YSize=multiplication, Radius=0)  # -> Rectangle, Length
boxrec = BoxRectangle(Rectangle=rectangle.Rectangle, Height=division)  # -> graft(Box)
brepsinc = PointInBreps(Brep=flatten(boxrec), Point=P_2, Strict=False)  # -> Inside, Index
brepinc = PointInBrep(Brep=boxrec, Point=P, Strict=False)
dispatch = Dispatch(List=L, DispatchPattern=brepinc)  # -> ListA, ListB
intcrv = Interpolate(Vertices=dispatch.ListA, Degree=3, Periodic=False, KnotStyle=1)  # -> flatten(Curve), Length, Domain
null = NullItem(Item=intcrv.Curve)  # -> NullFlags, InvalidFlags, Description
dispatch_2 = Dispatch(List=intcrv.Curve, DispatchPattern=null.NullFlags)  # -> ListA, ListB
loft = Loft(
    Curves=dispatch_2.ListB,
    Options={Adjust=False, Closed=False, LoftEnds=0, LoftSimp=0, LoftType=0, Rebuild=10, Refit=0.01})
L_2 = ClusterOutput(loft)
