# Grasshopper definition serialRead.gh (Grasshopper 0.9.75)
# plug-ins: Firefly.Core

number_slider = Slider(7, range=0..10)
ports_available = COMPortsAvailable()
panel = Panel(ports_available)
timer = Timer(TimerInterval=1000, Target=read)
open_port = OpenClosePort(OpenClosePort=Toggle(True), PortNumber=number_slider, BaudRate=Slider(9600, range=0..10000))
read = SerialReadGeneric(StartReadingValues=Toggle(True), PortNumber=number_slider)  # -> SerialOutput, StatusMessage
panel_2 = Panel(read.SerialOutput)
panel_3 = Panel(open_port)
panel_4 = Panel(read.StatusMessage)
serial_to_int = SerialToInt(T=read.SerialOutput)  # -> i_16, i_15, i_12, i_11, i_14, i_9, i_13, i_10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
button = Panel(serial_to_int.i)
flex_small_l = Panel(serial_to_int.i_16)
flex_small_r = Panel(serial_to_int.i_15)
flex_long_r = Panel(serial_to_int.i_11)
softpot_l = Panel(serial_to_int.i_14)
softpot_r = Panel(serial_to_int.i_9)
methane = Panel(serial_to_int.i_13)
fsr_l = Panel(serial_to_int.i_10)
temperature = Panel(serial_to_int.i_3)
accelerometer = Panel(serial_to_int.i_2)
button_2 = Panel(serial_to_int.i_5)
flex_long_l = Panel(serial_to_int.i_12)
fsr_r = Panel(serial_to_int.i_7)
ultrasonic = Panel(serial_to_int.i_6)

# ==== cluster SerialToInt
T = ClusterInput()
split = TextSplit(Text=T, Separators=" ")
_10 = Integer(10)
_9 = Integer(9)
_8 = Integer(8)
_13 = Integer(13)
_11 = Integer(11)
_14 = Integer(14)
_12 = Integer(12)
_15 = Integer(15)
_2 = Integer(2)
_0 = Integer(0)
_1 = Integer(1)
_5 = Integer(5)
_7 = Integer(7)
_3 = Integer(3)
_6 = Integer(6)
_4 = Integer(4)
item = ListItem(List=flatten(split), Index=_13, Wrap=True)
item_2 = ListItem(List=flatten(split), Index=_11, Wrap=True)
item_3 = ListItem(List=flatten(split), Index=_10, Wrap=True)
item_4 = ListItem(List=flatten(split), Index=_14, Wrap=True)
item_5 = ListItem(List=flatten(split), Index=_12, Wrap=True)
item_6 = ListItem(List=flatten(split), Index=_9, Wrap=True)
item_7 = ListItem(List=flatten(split), Index=_8, Wrap=True)
item_8 = ListItem(List=flatten(split), Index=_15, Wrap=True)
item_9 = ListItem(List=flatten(split), Index=_5, Wrap=True)
item_10 = ListItem(List=flatten(split), Index=_7, Wrap=True)
item_11 = ListItem(List=flatten(split), Index=_3, Wrap=True)
item_12 = ListItem(List=flatten(split), Index=_2, Wrap=True)
item_13 = ListItem(List=flatten(split), Index=_6, Wrap=True)
item_14 = ListItem(List=flatten(split), Index=_4, Wrap=True)
item_15 = ListItem(List=flatten(split), Index=_1, Wrap=True)
item_16 = ListItem(List=flatten(split), Index=_0, Wrap=True)
i = ClusterOutput(item)
i_2 = ClusterOutput(item_2)
i_3 = ClusterOutput(item_3)
i_4 = ClusterOutput(item_4)
i_5 = ClusterOutput(item_5)
i_6 = ClusterOutput(item_6)
i_7 = ClusterOutput(item_7)
i_8 = ClusterOutput(item_8)
i_9 = ClusterOutput(item_9)
i_10 = ClusterOutput(item_10)
i_11 = ClusterOutput(item_11)
i_12 = ClusterOutput(item_12)
i_13 = ClusterOutput(item_13)
i_14 = ClusterOutput(item_14)
i_15 = ClusterOutput(item_15)
i_16 = ClusterOutput(item_16)
