# Grasshopper definition Sit&Make_All.gh (Grasshopper 0.9.75)
# plug-ins: Weaverbird, Firefly.Core

ports_available = COMPortsAvailable()
panel = Panel(ports_available)
timer = Timer(TimerInterval=1000, Target=read)
open_port = OpenClosePort(OpenClosePort=Toggle(True), PortNumber=panel, BaudRate=Slider(9600, range=0..10000))
read = SerialReadGeneric(StartReadingValues=Toggle(True), PortNumber=panel)  # -> SerialOutput, StatusMessage
panel_2 = Panel(read.SerialOutput)
panel_3 = Panel(read.StatusMessage)
panel_4 = Panel(open_port)
split = TextSplit(Text=panel_2, Separators=" ")
lng = ListLength(List=split)
item = ListItem(List=split, Index=lng, Wrap=True)
panel_5 = Panel(item)
lng_2 = ListLength(List=split)
culln = CullNth(List=split, CullFrequency=lng_2)

timer_2 = Timer(TimerInterval=1000, Target=fader1)
fader1 = FaderOneWay(Value1="1", Value2="500", FadeInterval="50000", DelayOut=0)  # -> FadingOutput, LoopCounter
random = Random(Range=Domain(0, 1024), Number=12, Seed=fader1.FadingOutput)
round = Round(Number=random)  # -> Nearest, Floor, Ceiling

panel_6 = Panel(culln)
lng_3 = ListLength(List=panel_6)
button = Button()
subtraction = Subtraction(A=lng_3, B=1)
item_2 = ListItem(List=panel_6, Index=subtraction, Wrap=True)
toggle = BooleanToggle(True)
dispatch = Dispatch(List=panel_6, DispatchPattern=item_2)  # -> graft(ListA), ListB
rec = DataRecorder(dispatch.ListA, DataLimit=-10, RecordData=True)
lng_4 = ListLength(List=rec)
subtraction_2 = Subtraction(A=lng_4, B=1)
item_3 = ListItem(List=rec, Index=subtraction_2, Wrap=True)  # -> simplify(flatten(Item))
panel_7 = Panel(item_3)
item_4 = ListItem(List=panel_7, Index=0, Wrap=True)  # -> Item, Item1, Item2, Item3, Item4, Item5, Item6, Item7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
flex_long_r = Panel(item_4.Item3)
softpot_l = Panel(item_4.Item4)
flex_small_l = Panel(item_4.Item)
flex_small_r = Panel(item_4.Item1)
flex_long_l = Panel(item_4.Item2)
softpot_r = Panel(item_4.Item5)
methane = Panel(item_4.Item6)
fsr_l = Panel(item_4.Item7)
fsr_r = Panel(item_4.Item8)
ultrasonic = Panel(item_4.Item9)
temperature = Panel(item_4.Item10)
accelerometer = Panel(item_4.Item11)

panel_8 = Panel(rec)
lng_5 = ListLength(List=flatten(panel_8))

flex_long_r_2 = Slider(60, range=0..100)
flex_short_l = Slider(71, range=1..100)
fsr_r_2 = Slider(0, range=0..150)
temp = Slider(30, range=0..30)
flex_long_l_2 = Slider(4, range=0..50)
softpot_l_2 = Slider(0, range=0..100)
softpot_r_2 = Slider(0, range=0..100)
methane_2 = Slider(53, range=0..100)
fsr_l_2 = Slider(0, range=0..100)
ultrasound = Slider(44, range=0..100)
accelerometer_2 = Slider(1, range=1..8)
flex_short_r = Slider(57, range=1..100)
panel_9 = Panel([flex_short_l, flex_short_r, flex_long_l_2, flex_long_r_2, softpot_l_2, softpot_r_2, methane_2, fsr_l_2, fsr_r_2, ultrasound, temp, accelerometer_2])

graph = GraphMapper(
    flex_small_l,
    x0=430,
    x1=660,
    y0=1,
    y1=100,
    container_name="Bezier",
    cpx=[0, 0.8100558519, 1, 1],
    cpy=[1, 1, 0.1632047296, 0])
graph_2 = GraphMapper(
    flex_small_r,
    x0=493,
    x1=694,
    y0=1,
    y1=100,
    container_name="Bezier",
    cpx=[0, 0.7039105892, 1, 1],
    cpy=[1, 0.9940652847, 0.7268548012, 0])
graph_3 = GraphMapper(
    softpot_l,
    x0=140,
    x1=1000,
    y0=0,
    y1=100,
    A=1,
    B=0,
    container_name="Linear",
    Graph_x0=0.25,
    Graph_x1=0.75,
    Graph_y0=0.25,
    Graph_y1=0.75)
graph_4 = GraphMapper(
    methane,
    x0=140,
    x1=1000,
    y0=0,
    y1=100,
    A=1,
    B=0,
    container_name="Linear",
    Graph_x0=0.25,
    Graph_x1=0.75,
    Graph_y0=0.25,
    Graph_y1=0.75)
graph_5 = GraphMapper(
    flex_long_l,
    x0=780,
    x1=870,
    y0=0,
    y1=50,
    container_name="Bezier",
    cpx=[0, 0.792421937, 1, 1],
    cpy=[1, 0.8689998388, 0.1097922921, 0])
graph_6 = GraphMapper(
    flex_long_r,
    x0=759,
    x1=850,
    y0=0,
    y1=100,
    container_name="Bezier",
    cpx=[0, 0.954105854, 0.8163748384, 1],
    cpy=[1, 1, 0.700999856, 0])
graph_7 = GraphMapper(
    softpot_r,
    x0=140,
    x1=1000,
    y0=0,
    y1=100,
    A=1,
    B=0,
    container_name="Linear",
    Graph_x0=0.25,
    Graph_x1=0.75,
    Graph_y0=0.25,
    Graph_y1=0.75)
graph_8 = GraphMapper(fsr_l, x0=140, x1=1000, y0=0, y1=100, container_name="Bezier", cpx=[0, 0.3882107139, 0, 1], cpy=[0, 0.2568553686, 1, 1])
graph_9 = GraphMapper(fsr_r, x0=140, x1=1000, y0=0, y1=150, container_name="Bezier", cpx=[0, 0.3882107139, 0, 1], cpy=[0, 0.2568553686, 1, 1])
graph_10 = GraphMapper(
    ultrasonic,
    x0=0,
    x1=50,
    y0=0,
    y1=100,
    container_name="Bezier",
    cpx=[0, 0.3860948384, 0.9525139928, 1],
    cpy=[0, 0.1976554394, 0.3471810222, 1])
graph_11 = GraphMapper(
    temperature,
    x0=60,
    x1=100,
    y0=0,
    y1=30,
    container_name="Bezier",
    cpx=[0, 0.4804469347, 0.6759776473, 1],
    cpy=[0, 0.6735905409, 0.4955489635, 1])
graph_12 = GraphMapper(
    accelerometer,
    x0=1,
    x1=8,
    y0=1,
    y1=8,
    container_name="Bezier",
    cpx=[0, 0.7653631568, 0.9245809913, 1],
    cpy=[0, 0.3827893138, 0.4035608172, 1])
round_2 = Round(Number=graph_12)  # -> Nearest, Floor, Ceiling
panel_10 = Panel([graph, graph_2, graph_5, graph_6, graph_3, graph_7, graph_4, graph_8, graph_9, graph_10, graph_11, round_2.Nearest])

log = DataLog(ResetLog=Button(), StartRecording=True, WrapValues=False, RecordingLength=0)  # -> simplify(OutputLog)
panel_11 = Panel(log)
int = Integer(panel_11)
graph_13 = QuickGraph(panel_11)
sort = SortList(Keys=panel_11)  # -> Keys, ValuesA
avr = Average(Input=int)
lng_6 = ListLength(List=sort.Keys)
subtraction_3 = Subtraction(A=lng_6, B=1)
item_5 = ListItem(List=sort.Keys, Index=0, Wrap=True)
panel_12 = Panel(avr)
item_6 = ListItem(List=sort.Keys, Index=subtraction_3, Wrap=False)
panel_13 = Panel(item_5)
panel_14 = Panel(item_6)

panel_15 = Panel(panel_10)
X = UnitX(Factor=1)
multiplication = Multiplication(A=X, B=Slider(174, range=0..1000))

item_7 = ListItem(List=panel_15, Index=0, Wrap=True)  # -> Item, Item1, Item2, Item3, Item4, Item5, Item6, Item7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

larger = LargerThan(FirstNumber=item_7.Item, SecondNumber=item_7.Item1)  # -> LargerThan, OrEqualTo
expression = Expression(x=larger.LargerThan, A=item_7.Item1, B=item_7.Item, Expression="If(x, A, B)")
subtraction_4 = Subtraction(A=item_7.Item3, B=expression)
division = Division(A=item_7.Item1, B=-2)
division_2 = Division(A=item_7.Item, B=-2)
division_3 = Division(A=subtraction_4, B=-2)
addition = Addition(A=division_3, B=division)
addition_2 = Addition(A=division_3, B=division_2)
pt = ConstructPoint(XCoordinate=division_2, YCoordinate=division, ZCoordinate=0)
pt_2 = ConstructPoint(XCoordinate=addition_2, YCoordinate=addition, ZCoordinate=0)
multiplication_2 = Multiplication(A=item_7.Item9, B=-1)
pl_offset = PlaneOffset(BasePlane=pt_2, Offset=multiplication_2)
addition_3 = Addition(A=subtraction_4, B=item_7.Item)
addition_4 = Addition(A=subtraction_4, B=item_7.Item1)
rectangle = Rectangle(Plane=pl_offset, XSize=addition_3, YSize=addition_4, Radius=0)  # -> Rectangle, Length
rectangle_2 = Rectangle(Plane=pt, XSize=item_7.Item, YSize=item_7.Item1, Radius=0)  # -> Rectangle, Length
loft = Loft(
    Curves=[rectangle.Rectangle, rectangle_2.Rectangle],
    Options={Adjust=False, Closed=False, LoftEnds=0, LoftSimp=0, LoftType=0, Rebuild=10, Refit=0.01})
boxrec = BoxRectangle(Rectangle=rectangle_2.Rectangle, Height=item_7.Item2)

xy = XYPlane(Origin=Point(0, 0, 0))
prot = RotatePlane(Plane=xy, Angle=4.71238898)
sqrt = SquareRoot(Value=item_7.Item11)
cir = Circle(Plane=prot, Radius=100)
divide = DivideCurve(Curve=cir, Count=item_7.Item11, Kinks=False)  # -> Points, Tangents, Parameters
division_4 = Division(A=item_7.Item2, B=sqrt)
ln = Line(StartPoint=xy, EndPoint=divide.Points)
multiplication_3 = Multiplication(A=division_4, B=-1)
offset = Offset(Curve=ln, Distance=graft([multiplication_3, division_4]), Plane=PlaneXY(0, 0, 0), Corners=2)  # -> simplify(Curve)
path_mapper = PathMapper(offset, source="{A;B}", target="{B}(A)")
cp = ControlPoints(Curve=path_mapper)  # -> Points, Weights, Knots
path_mapper_2 = PathMapper(cp.Points, source="{A;B}(i)", target="{A}")
panel_16 = Panel("""0
1
3
2""")
item_8 = ListItem(List=path_mapper_2, Index=panel_16, Wrap=True)
Z = UnitZ(Factor=1)
pline = PolyLine(Vertices=item_8, Closed=True)
multiplication_4 = Multiplication(A=Z, B=item_7.Item9)
multiplication_5 = Multiplication(A=multiplication_4, B=-1.1)
extr = Extrude(Base=pline, Direction=multiplication_5)
cap = CapHoles(Brep=extr)  # -> flatten(Brep)

debrep = DeconstructBrep(Brep=boxrec)  # -> Faces, Edges, Vertices
item_9 = ListItem(List=debrep.Vertices, Index=3, Wrap=True)
addition_5 = Addition(A=item_7.Item2, B=item_7.Item10)
rectangle_3 = Rectangle(Plane=item_9, XSize=item_7.Item, YSize=item_7.Item2, Radius=0)  # -> Rectangle, Length
boxrec_2 = BoxRectangle(Rectangle=rectangle_3.Rectangle, Height=addition_5)

multiplication_6 = Multiplication(A=item_7.Item2, B=-1)
multiplication_7 = Multiplication(A=item_7.Item4, B=-1)
rectangle_4 = Rectangle(Plane=item_9, XSize=multiplication_6, YSize=multiplication_7, Radius=0)  # -> Rectangle, Length
boxrec_3 = BoxRectangle(Rectangle=rectangle_4.Rectangle, Height=item_7.Item5)
mirror = Mirror(Geometry=boxrec_3, Plane=PlaneYZ(0, 0, 0))  # -> Geometry, Transform

cap_2 = CapHoles(Brep=loft)
sdiff = SolidDifference(BrepsA=cap_2, BrepsB=cap)  # -> graft(Result)
equals = Equality(FirstNumber=item_7.Item11, SecondNumber=1)  # -> Equality, Inequality
dispatch_2 = Dispatch(List=cap_2, DispatchPattern=equals.Equality)  # -> ListA, ListB
dispatch_3 = Dispatch(List=sdiff, DispatchPattern=equals.Inequality)  # -> ListA, ListB
geo = Geometry([dispatch_2.ListA, dispatch_3.ListA])

xy_2 = XYPlane(Origin=Point(0, 0, 0))
Z_2 = UnitZ(Factor=1)
addition_6 = Addition(A=item_7.Item2, B=30)
pl_origin = PlaneOrigin(Base=xy_2, Origin=item_9)
multiplication_8 = Multiplication(A=Z_2, B=addition_6)
pl_offset_2 = PlaneOffset(BasePlane=pl_origin, Offset=multiplication_8)
subtraction_5 = Subtraction(A=item_7.Item, B=item_7.Item8)
X_2 = UnitX(Factor=1)
division_5 = Division(A=subtraction_5, B=2)
multiplication_9 = Multiplication(A=X_2, B=division_5)

deplane = DeconstructPlane(Plane=pl_offset_2)  # -> Origin, XAxis, YAxis, ZAxis

addition_7 = Addition(A=deplane.Origin, B=multiplication_9)
pl = ConstructPlane(Origin=addition_7, XAxis=deplane.XAxis, YAxis=deplane.YAxis)
rectangle_5 = Rectangle(Plane=pl, XSize=item_7.Item8, YSize=item_7.Item2, Radius=0)  # -> Rectangle, Length
boxrec_4 = BoxRectangle(Rectangle=rectangle_5.Rectangle, Height=item_7.Item7)

geo_2 = Geometry(flatten([geo, boxrec_2, mirror.Geometry, boxrec_3, boxrec, boxrec_4]))

number_slider = Slider(17, range=0..500)
pop3d = Populate3D(Region=geo_2, Count=Slider(3, range=1..5), Seed=lng_5)  # -> flatten(Population)

item_10 = ListItem(List=panel_15, Index=0, Wrap=True)  # -> Item, Item1, Item2, Item3, Item4, Item5, Item6, Item7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
del = DelaunayMesh(Points=pop3d, Plane=PlaneXY(0, 0, 0))
wbframe = WeaverbirdsPictureFrame(MeshPolylines=del, Distance=Slider(13, range=1..30), InsetType=0)

wbbevelvertices = WeaverbirdsBevelVertices(MeshPolylines=del, Distance=Slider(39, range=15..50), InsetType=0, OutputGeometryAsMesh=True)

wbtriangles = WeaverbirdsSplitTrianglesSubdivision(MeshCurves=del, Level=1)
wbloop = WeaverbirdsLoopSubdivision(MeshCurves=wbtriangles, Level=Slider(3, range=1..3), SmoothNakedEdges=1)

wbbevelvertices_2 = WeaverbirdsBevelVertices(MeshPolylines=wbloop, Distance=Slider(31, range=15..50), InsetType=0, OutputGeometryAsMesh=True)
wbframe_2 = WeaverbirdsPictureFrame(MeshPolylines=wbloop, Distance=Slider(6, range=1..40), InsetType=0)
wbbeveledges = WeaverbirdsBevelEdges(MeshPolylines=wbloop, Distance=Slider(29, range=1..50), InsetType=0)
wbthicken = WeaverbirdsMeshThicken(MeshCurves=wbbeveledges, Distance=Slider(0.54, range=0.25..1), OffsetType=0)
geo_3 = Geometry(wbthicken)

move = Move(Geometry=geo_3, Motion=multiplication)  # -> Geometry, Transform
